# Grasshopper definition helloPython.gh (Grasshopper 0.9.75)
# plug-ins: Python Interpreter

# - where is the geometry?!!?
# - i had to reinstall the component for it to work correct.
# - you have to run this via f5 or else close the window
# - and then it bakes at the same time
# - this code is incomprehensible inside the external gh file
# - this is dangerous! there is no diff between running and editing
number_slider = Slider(5, range=0..10)
python = PythonScript(x=number_slider)  # -> out, a
# ---------- python: Python ----------
import rhinoscriptsyntax as rs

for i in xrange(x):
    rs.AddCylinder((i*i, 0, 0), i+i, i)
    print "hello py"

# note this bakes everything!!!
#geometry = ghdoc.Objects.Geometries - this is not required
# ---------- end python ----------
panel = Panel(python.out)
panel_2 = Panel(python.a)
